# Grasshopper definition 003_001_001_Cube.gh (Grasshopper 1.0.7)
# plug-ins: RhinoCodePluginGH

# ----
# Part 3: Area, Volume and Surface Area
# 3.2 Volume
# 003_002_001_Cube
# gpt-4 Text Prompt
# Use this script editor template to create a script
#  for the C# node in grasshopper for rhino8 that
# models geometry for the
# 
# VOLUME
# 
# and specifically the
# 
# CUBE
# 
# //Grasshopper Script Instance
# //#! csharp
# using System;
# using System.Collections;
# using System.Collections.Generic;
# using System.Drawing;
# 
# using Rhino;
# using Rhino.Geometry;
# 
# using Grasshopper;
# using Grasshopper.Kernel;
# using Grasshopper.Kernel.Data;
# using Grasshopper.Kernel.Types;
# 
# public class Script_Instance : GH_ScriptInstance
# {
#   /*
#     Members:
#       RhinoDoc RhinoDocument
#       GH_Document GrasshopperDocument
#       IGH_Component Component
#       int Iteration
# 
#     Methods (Virtual & overridable):
#       Print(string text)
#       Print(string format, params object[] args)
#       Reflect(object obj)
#       Reflect(object obj, string method_name)
#   */
# 
#   private void RunScript(object x, object y, out object a)
#   {
#     // Write your logic here
#     a = null;
#   }
# }
# BASIC SCRIPT
number_slider = Slider(3.66, range=0..10)
# C# | Mathematics | Grasshopper
# ALL DOWNLOADS AT:
# www.wickersonstudios.com
# If you'd like to create a cube in the
# Grasshopper's C# node based on a given base
# point (x, y) and a given side length, you can
# follow this script:
construct_point = ConstructPoint(XCoordinate=0, YCoordinate=0, ZCoordinate=0)
cube = Script(basePoint=construct_point, sideLength=number_slider)  # -> out, cube; inputs basePoint: Point3d, sideLength: Double
# ---------- cube: C# ----------
//Grasshopper Script Instance
//#! csharp
using System;
using System.Collections;
using System.Collections.Generic;
using System.Drawing;

using Rhino;
using Rhino.Geometry;

using Grasshopper;
using Grasshopper.Kernel;
using Grasshopper.Kernel.Data;
using Grasshopper.Kernel.Types;

public class Script_Instance : GH_ScriptInstance
{
    /*
    Members:
        RhinoDoc RhinoDocument
        GH_Document GrasshopperDocument
        IGH_Component Component
        int Iteration

    Methods (Virtual & overridable):
        Print(string text)
        Print(string format, params object[] args)
        Reflect(object obj)
        Reflect(object obj, string method_name)
    */

    private void RunScript(Rhino.Geometry.Point3d basePoint, double sideLength, out object cube)
    {
        // Define the base plane at the base point with normal in the Z direction
        Plane basePlane = new Plane(basePoint, Vector3d.ZAxis);
        
        // Define intervals for the box based on the side length
        Interval interval = new Interval(0, sideLength);

        // Create the cube's box geometry
        cube = new Box(basePlane, interval, interval, interval);
    }
}
# ---------- end cube ----------
panel = Panel(cube.out)
entwine = Entwine(Branch00=cube.cube, FlattenInputs=True)
panel_2 = Panel(entwine)
