# Grasshopper definition 003_001_001_Triangle.gh (Grasshopper 1.0.7)
# plug-ins: RhinoCodePluginGH

number_slider = Slider(10, range=0..10)  # disabled
# C# | Mathematics | Grasshopper
# ALL DOWNLOADS AT:
# www.wickersonstudios.com
# Part 3: Area, Volume and Surface Area
# 3.1 Area:
# 003_001_001_triangle
# gpt-4 Text Prompt
# To create a simple Grasshopper component
# that computes the area of a triangle in the C#
# node in Grasshopper for Rhino 8, you'll first
# need the base points of the triangle. For this
# script, let's assume you input three points: A, B,
# and C which represent the vertices of the triangle.
# The formula for the area of a triangle
# given its three vertices is:
# Use this script editor template to create a script
#  for the C# node in grasshopper for rhino8 that
# models geometry for the
# 
# AREA
# 
# and specifically the
# 
# TRIANGLE
# 
# //Grasshopper Script Instance
# //#! csharp
# using System;
# using System.Collections;
# using System.Collections.Generic;
# using System.Drawing;
# 
# using Rhino;
# using Rhino.Geometry;
# 
# using Grasshopper;
# using Grasshopper.Kernel;
# using Grasshopper.Kernel.Data;
# using Grasshopper.Kernel.Types;
# 
# public class Script_Instance : GH_ScriptInstance
# {
#   /*
#     Members:
#       RhinoDoc RhinoDocument
#       GH_Document GrasshopperDocument
#       IGH_Component Component
#       int Iteration
# 
#     Methods (Virtual & overridable):
#       Print(string text)
#       Print(string format, params object[] args)
#       Reflect(object obj)
#       Reflect(object obj, string method_name)
#   */
# 
#   private void RunScript(object x, object y, out object a)
#   {
#     // Write your logic here
#     a = null;
#   }
# }
# BASIC SCRIPT
# computedArea = 0.5 * Math.Abs(xA * (yB - yC) + xB * (yC - yA) + xC * (yA - yB));
number_slider_2 = Slider(10, range=0..10)  # disabled
# ADVANCED SCRIPT
# computedArea = 0.5 * crossProduct.Length
number_slider_3 = Slider(1, range=0..10)
construct_point = ConstructPoint(XCoordinate=number_slider_2, YCoordinate=0, ZCoordinate=0)  # disabled
construct_point_2 = ConstructPoint(XCoordinate=0, YCoordinate=number_slider, ZCoordinate=0)  # disabled
construct_point_3 = ConstructPoint(XCoordinate=0, YCoordinate=0, ZCoordinate="0")  # disabled
construct_point_4 = ConstructPoint(XCoordinate=number_slider_3, YCoordinate=0, ZCoordinate=0)
construct_point_5 = ConstructPoint(XCoordinate=0, YCoordinate=Slider(1, range=0..10), ZCoordinate=0)
construct_point_6 = ConstructPoint(XCoordinate=0, YCoordinate=0, ZCoordinate=Slider(1.28, range=0..10))
triangle = Script(A=construct_point, B=construct_point_2, C=construct_point_3)  # -> out, area; inputs A: Point3d, B: Point3d, C: Point3d; disabled
# ---------- triangle: C# ----------
//Grasshopper Script Instance
//#! csharp
using System;
using System.Collections;
using System.Collections.Generic;
using System.Drawing;

using Rhino;
using Rhino.Geometry;

using Grasshopper;
using Grasshopper.Kernel;
using Grasshopper.Kernel.Data;
using Grasshopper.Kernel.Types;

public class Script_Instance : GH_ScriptInstance
{
  /* 
    Members:
      RhinoDoc RhinoDocument
      GH_Document GrasshopperDocument
      IGH_Component Component
      int Iteration

    Methods (Virtual & overridable):
      Print(string text)
      Print(string format, params object[] args)
      Reflect(object obj)
      Reflect(object obj, string method_name)
  */
  
  private void RunScript(Rhino.Geometry.Point3d A, Rhino.Geometry.Point3d B, Rhino.Geometry.Point3d C, out object area)
  {
    area = TriangleArea(A, B, C);
  }

  // Method to compute the area of the triangle
  private double TriangleArea(Point3d A, Point3d B, Point3d C)
  {
    double xA = A.X;
    double yA = A.Y;
    double xB = B.X;
    double yB = B.Y;
    double xC = C.X;
    double yC = C.Y;

    double computedArea = 0.5 * Math.Abs(xA * (yB - yC) + xB * (yC - yA) + xC * (yA - yB));
    return computedArea;
  }
}
# ---------- end triangle ----------
entwine = Entwine(Branch00=triangle.area, FlattenInputs=True)  # disabled
panel = Panel(triangle.out)  # disabled
_4point_surface = _4PointSurface(CornerA=construct_point, CornerB=construct_point_2, CornerC=construct_point_3)  # disabled
_4point_surface_2 = _4PointSurface(CornerA=construct_point_4, CornerB=construct_point_5, CornerC=construct_point_6)
triangle_2 = Script(A=construct_point_4, B=construct_point_5, C=construct_point_6)  # -> out, area; inputs A: Point3d, B: Point3d, C: Point3d
# ---------- triangle_2: C# ----------
//Grasshopper Script Instance
//#! csharp
using System;
using System.Collections;
using System.Collections.Generic;
using System.Drawing;

using Rhino;
using Rhino.Geometry;

using Grasshopper;
using Grasshopper.Kernel;
using Grasshopper.Kernel.Data;
using Grasshopper.Kernel.Types;

public class Script_Instance : GH_ScriptInstance
{
  
  private void RunScript(Rhino.Geometry.Point3d A, Rhino.Geometry.Point3d B, Rhino.Geometry.Point3d C, out object area)
  {
    area = TriangleArea(A, B, C);
  }

  // Method to compute the area of the triangle
  private double TriangleArea(Point3d A, Point3d B, Point3d C)
  {
    Vector3d AB = B - A;
    Vector3d AC = C - A;

    // Cross product of the two vectors
    Vector3d crossProduct = Vector3d.CrossProduct(AB, AC);

    // The area of the triangle is half of the magnitude of the cross product
    double computedArea = 0.5 * crossProduct.Length;
    return computedArea;
  }
}
# ---------- end triangle_2 ----------
panel_2 = Panel(entwine)  # disabled
area = Area(Geometry=_4point_surface_2)  # -> Area, Centroid
panel_3 = Panel(triangle_2.out)
entwine_2 = Entwine(Branch00=triangle_2.area, Branch01=area.Area, FlattenInputs=True)
panel_4 = Panel(entwine_2)
