# Grasshopper definition 003_001_002_Cuboid.gh (Grasshopper 1.0.7)
# plug-ins: RhinoCodePluginGH

# ----
# BASIC SCRIPT
number_slider = Slider(10, range=0..10)
# C# | Mathematics | Grasshopper
# ALL DOWNLOADS AT:
# www.wickersonstudios.com
# Part 3: Area, Volume and Surface Area
# 3.2 Volume
# 003_001_002_Cuboid
# Alright, let's break down the task and build the
# script accordingly.
# 
# Task: Create a cuboid using the formula
# v=abc. Here
# v is the volume and
# a, b, and c are the dimensions of the cuboid.
# 
# Inputs: From your description, I'm assuming that
#  the volume
# v is provided as input, and perhaps one or two
# dimensions, and we need to calculate the
# remaining dimensions.
# 
# Output: The script should output a Box (Rhino's
# geometry for a cuboid) that matches the
# provided volume.
# 
# For simplicity, let's assume
# a and b are provided as inputs, and you want to
#  calculate c.
# gpt-4 Text Prompt
# Use this script editor template to create a script
#  for the C# node in grasshopper for rhino8 that
# models geometry for the
# 
# VOLUME
# 
# and specifically the
# 
# CUBOID v = abc
# 
# //Grasshopper Script Instance
# //#! csharp
# using System;
# using System.Collections;
# using System.Collections.Generic;
# using System.Drawing;
# 
# using Rhino;
# using Rhino.Geometry;
# 
# using Grasshopper;
# using Grasshopper.Kernel;
# using Grasshopper.Kernel.Data;
# using Grasshopper.Kernel.Types;
# 
# public class Script_Instance : GH_ScriptInstance
# {
#   /*
#     Members:
#       RhinoDoc RhinoDocument
#       GH_Document GrasshopperDocument
#       IGH_Component Component
#       int Iteration
# 
#     Methods (Virtual & overridable):
#       Print(string text)
#       Print(string format, params object[] args)
#       Reflect(object obj)
#       Reflect(object obj, string method_name)
#   */
# 
#   private void RunScript(object x, object y, out object a)
#   {
#     // Write your logic here
#     a = null;
#   }
# }
number_slider_2 = Slider(2.16, range=0..10)
cuboid = Script(a=number_slider_2, b=Slider(1.84, range=0..10), v=number_slider)  # -> out, BoxGeometry; inputs a: Double, b: Double, v: Double
# ---------- cuboid: C# ----------
//Grasshopper Script Instance
//#! csharp
using System;
using System.Collections;
using System.Collections.Generic;
using System.Drawing;

using Rhino;
using Rhino.Geometry;

using Grasshopper;
using Grasshopper.Kernel;
using Grasshopper.Kernel.Data;
using Grasshopper.Kernel.Types;

public class Script_Instance : GH_ScriptInstance
{
  private void RunScript(double a, double b, double v, out object BoxGeometry)
  {
    // Calculate the third dimension c using the volume v and provided dimensions a and b.
    double c = v / (a * b);

    // Create the box geometry using a base plane, and the 3 dimensions.
    Plane basePlane = Plane.WorldXY;
    BoxGeometry = new Box(basePlane, new Interval(0, a), new Interval(0, b), new Interval(0, c));
  }
}
# ---------- end cuboid ----------
entwine = Entwine(Branch00=cuboid.BoxGeometry, FlattenInputs=True)
panel = Panel(cuboid.out)
panel_2 = Panel(entwine)
