# Grasshopper definition 003_001_002_Rectangle.gh (Grasshopper 1.0.7)
# plug-ins: RhinoCodePluginGH

# ----
# C# | Mathematics | Grasshopper
# ALL DOWNLOADS AT:
# www.wickersonstudios.com
# Part 3: Area, Volume and Surface Area
# 3.1 Area:
# 003_001_002_Rectangle
# gpt-4 Text Prompt
# Alright! The given code serves as a template for
# a Grasshopper component in Rhino. You've
# specified a need to model geometry for the
# AREA and specifically the RECTANGLE.
# 
# Let's start with modeling a rectangle. A
# rectangle can be defined by its bottom-left
# corner point, width, and height.
# 
# To make a Grasshopper node that takes in
# these parameters and outputs a rectangle:
# 
# We'll define input for the bottom-left corner,
# width, and height.
# We'll generate a rectangle with these inputs.
# Output the created rectangle to a.
# Use this script editor template to create a script
#  for the C# node in grasshopper for rhino8 that
# models geometry for the
# 
# AREA
# 
# and specifically the
# 
# RECTANGLE
# 
# //Grasshopper Script Instance
# //#! csharp
# using System;
# using System.Collections;
# using System.Collections.Generic;
# using System.Drawing;
# 
# using Rhino;
# using Rhino.Geometry;
# 
# using Grasshopper;
# using Grasshopper.Kernel;
# using Grasshopper.Kernel.Data;
# using Grasshopper.Kernel.Types;
# 
# public class Script_Instance : GH_ScriptInstance
# {
#   /*
#     Members:
#       RhinoDoc RhinoDocument
#       GH_Document GrasshopperDocument
#       IGH_Component Component
#       int Iteration
# 
#     Methods (Virtual & overridable):
#       Print(string text)
#       Print(string format, params object[] args)
#       Reflect(object obj)
#       Reflect(object obj, string method_name)
#   */
# 
#   private void RunScript(object x, object y, out object a)
#   {
#     // Write your logic here
#     a = null;
#   }
# }
# BASIC SCRIPT
# Rectangle3d rectangle = new Rectangle3d
# (Plane.WorldXY, bottomLeft, new Point3d
# (bottomLeft.X + width, bottomLeft.Y + height,
# bottomLeft.Z));
number_slider = Slider(0, range=0..10)
construct_point = ConstructPoint(XCoordinate=number_slider, YCoordinate=0, ZCoordinate=0)
rectangle = Script(bottomLeft=construct_point, width=Slider(6.42, range=0..10), height=Slider(5.94, range=0..10))  # -> out, a; inputs bottomLeft: Point3d, width: Double, height: Double
# ---------- rectangle: C# ----------
//Grasshopper Script Instance
//#! csharp
using System;
using System.Collections;
using System.Collections.Generic;
using System.Drawing;

using Rhino;
using Rhino.Geometry;

using Grasshopper;
using Grasshopper.Kernel;
using Grasshopper.Kernel.Data;
using Grasshopper.Kernel.Types;

public class Script_Instance : GH_ScriptInstance
{
  /* 
    Members:
      RhinoDoc RhinoDocument
      GH_Document GrasshopperDocument
      IGH_Component Component
      int Iteration

    Methods (Virtual & overridable):
      Print(string text)
      Print(string format, params object[] args)
      Reflect(object obj)
      Reflect(object obj, string method_name)
  */

  private void RunScript(Rhino.Geometry.Point3d bottomLeft, double width, double height, out object a)
  {
    Rectangle3d rectangle = new Rectangle3d(Plane.WorldXY, bottomLeft, new Point3d(bottomLeft.X + width, bottomLeft.Y + height, bottomLeft.Z));
    a = rectangle;
  }
}
# ---------- end rectangle ----------
panel = Panel(rectangle.out)
entwine = Entwine(Branch00=rectangle.a, FlattenInputs=True)
panel_2 = Panel(entwine)
