# Grasshopper definition 003_001_003_Parallelogram.gh (Grasshopper 1.0.7)
# plug-ins: RhinoCodePluginGH

# ----
# BASIC SCRIPT
# parallelogram = new Polyline(points)
number_slider = Slider(5.78, range=0..10)
# C# | Mathematics | Grasshopper
# ALL DOWNLOADS AT:
# www.wickersonstudios.com
# Part 3: Area, Volume and Surface Area
# 3.1 Area:
# 003_001_003_Parallelogram
# gpt-4 Text Prompt
# Alright, let's write a C# script for modeling a
# parallelogram in the Grasshopper environment
# of Rhino 8.
# 
# For the parallelogram, I'll assume you want to
# create it based on a starting point, a base
# vector, and a side vector. Given these inputs,
# you can construct the parallelogram's geometry.
# Use this script editor template to create a script
#  for the C# node in grasshopper for rhino8 that
# models geometry for the
# 
# AREA
# 
# and specifically the
# 
# PARALLELOGRAM
# 
# //Grasshopper Script Instance
# //#! csharp
# using System;
# using System.Collections;
# using System.Collections.Generic;
# using System.Drawing;
# 
# using Rhino;
# using Rhino.Geometry;
# 
# using Grasshopper;
# using Grasshopper.Kernel;
# using Grasshopper.Kernel.Data;
# using Grasshopper.Kernel.Types;
# 
# public class Script_Instance : GH_ScriptInstance
# {
#   /*
#     Members:
#       RhinoDoc RhinoDocument
#       GH_Document GrasshopperDocument
#       IGH_Component Component
#       int Iteration
# 
#     Methods (Virtual & overridable):
#       Print(string text)
#       Print(string format, params object[] args)
#       Reflect(object obj)
#       Reflect(object obj, string method_name)
#   */
# 
#   private void RunScript(object x, object y, out object a)
#   {
#     // Write your logic here
#     a = null;
#   }
# }
number_slider_2 = Slider(0, range=0..10)
vector_xyz = VectorXYZ(XComponent=number_slider, YComponent=Slider(1.14, range=0..10), ZComponent=Slider(1.14, range=0..10))  # -> Vector, Length
vector_xyz_2 = VectorXYZ(XComponent=Slider(5.06, range=0..10), YComponent=Slider(5.06, range=0..10), ZComponent=Slider(3.94, range=0..10))  # -> Vector, Length
construct_point = ConstructPoint(XCoordinate=number_slider_2, YCoordinate=0, ZCoordinate=0)
parallelogram = Script(startPoint=construct_point, baseVec=vector_xyz.Vector, sideVec=vector_xyz_2.Vector)  # -> out, parallelogram; inputs startPoint: Point3d, baseVec: Vector3d, sideVec: Vector3d
# ---------- parallelogram: C# ----------
using System;
using System.Collections;
using System.Collections.Generic;
using System.Drawing;

using Rhino;
using Rhino.Geometry;

using Grasshopper;
using Grasshopper.Kernel;
using Grasshopper.Kernel.Data;
using Grasshopper.Kernel.Types;

public class Script_Instance : GH_ScriptInstance
{
    /* 
      Members:
        RhinoDoc RhinoDocument
        GH_Document GrasshopperDocument
        IGH_Component Component
        int Iteration

      Methods (Virtual & overridable):
        Print(string text)
        Print(string format, params object[] args)
        Reflect(object obj)
        Reflect(object obj, string method_name)
    */

    private void RunScript(Rhino.Geometry.Point3d startPoint, Rhino.Geometry.Vector3d baseVec, Rhino.Geometry.Vector3d sideVec, out object parallelogram)
    {
        List<Point3d> points = new List<Point3d>();
        points.Add(startPoint); // Add the starting point
        points.Add(startPoint + baseVec); // Add the second point based on base vector
        points.Add(startPoint + baseVec + sideVec); // Add the third point
        points.Add(startPoint + sideVec); // Add the fourth point
        points.Add(startPoint); // Close the polyline

        parallelogram = new Polyline(points);
    }
}
# ---------- end parallelogram ----------
vector_display = VectorDisplay(Anchor=construct_point, Vector=vector_xyz_2.Vector)
vector_display_2 = VectorDisplay(Anchor=construct_point, Vector=vector_xyz.Vector)
panel = Panel(parallelogram.out)
entwine = Entwine(Branch00=parallelogram.parallelogram, FlattenInputs=True)
polyline = PolyLine(Vertices=parallelogram.parallelogram, Closed=False)
panel_2 = Panel(entwine)
