# Grasshopper definition 003_001_003_Prism.gh (Grasshopper 1.0.7)
# plug-ins: RhinoCodePluginGH, Bifocals

# ----
# C# | Mathematics | Grasshopper
# ALL DOWNLOADS AT:
# www.wickersonstudios.com
# Part 3: Area, Volume and Surface Area
# 3.2 Volume
# 003_002_003_Prism
# gpt-4 Text Prompt
# Use this script editor template to create a script
#  for the C# node in grasshopper for rhino8 that
# models geometry for the
# 
# VOLUME
# 
# and specifically the
# 
# PRISM V = A(b)*h
# 
# //Grasshopper Script Instance
# //#! csharp
# using System;
# using System.Collections;
# using System.Collections.Generic;
# using System.Drawing;
# 
# using Rhino;
# using Rhino.Geometry;
# 
# using Grasshopper;
# using Grasshopper.Kernel;
# using Grasshopper.Kernel.Data;
# using Grasshopper.Kernel.Types;
# 
# public class Script_Instance : GH_ScriptInstance
# {
#   /*
#     Members:
#       RhinoDoc RhinoDocument
#       GH_Document GrasshopperDocument
#       IGH_Component Component
#       int Iteration
# 
#     Methods (Virtual & overridable):
#       Print(string text)
#       Print(string format, params object[] args)
#       Reflect(object obj)
#       Reflect(object obj, string method_name)
#   */
# 
#   private void RunScript(object x, object y, out object a)
#   {
#     // Write your logic here
#     a = null;
#   }
# }
# BASIC SCRIPT
number_slider = Slider(9, range=3..15)
# Sure, I can help with that! If you're aiming to
# calculate the volume of a prism using
# Grasshopper and Rhino, I can provide a script
# based on the formula you provided: V = A(b) * h,
#  where
# 
# A(b) is the area of the base of the prism and
# h is its height.
# 
# The following script assumes that the base of
# the prism is given as a Curve (which will be
# planar and closed) and the height is given as a
# double. The script will then calculate the volume
# of the prism.
polygon = Polygon(Plane=PlaneXY(0, 0, 0), Radius=3, Segments=number_slider, FilletRadius=0)  # -> Polygon, Length
curve = Curve(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)
prism = Script(baseCurve=curve, height=Slider(2.72, range=0..10))  # -> out, volume, prismGeometry; inputs baseCurve: Curve, height: Double
# ---------- prism: C# ----------
//Grasshopper Script Instance
//#! csharp
using System;
using System.Collections;
using System.Collections.Generic;
using System.Drawing;

using Rhino;
using Rhino.Geometry;

using Grasshopper;
using Grasshopper.Kernel;
using Grasshopper.Kernel.Data;
using Grasshopper.Kernel.Types;

public class Script_Instance : GH_ScriptInstance
{
  /* 
    Members:
      RhinoDoc RhinoDocument
      GH_Document GrasshopperDocument
      IGH_Component Component
      int Iteration

    Methods (Virtual & overridable):
      Print(string text)
      Print(string format, params object[] args)
      Reflect(object obj)
      Reflect(object obj, string method_name)
  */

  private void RunScript(Rhino.Geometry.Curve baseCurve, double height, out object volume, out object prismGeometry)
  {
    prismGeometry = null;

    // Check if the input curve is planar and closed
    if(baseCurve != null && baseCurve.IsPlanar() && baseCurve.IsClosed)
    {
      // Calculate the area of the base curve
      double baseArea;
      AreaMassProperties amp = AreaMassProperties.Compute(baseCurve);
      if (amp != null)
      {
        baseArea = amp.Area;

        // Calculate the volume of the prism
        volume = baseArea * height;

        // Create the prism geometry by extruding the base curve
        Vector3d extrusionDirection = new Vector3d(0, 0, height); // Extrude in Z direction
        Brep tempPrism = Surface.CreateExtrusion(baseCurve, extrusionDirection)?.ToBrep(); // Extrude the curve and convert to Brep

        if (tempPrism != null)
        {
          // Cap the prism
          prismGeometry = tempPrism.CapPlanarHoles(RhinoDoc.ActiveDoc.ModelAbsoluteTolerance);
        }
      }
      else
      {
        volume = "Failed to compute base area.";
      }
    }
    else
    {
      volume = "Provide a valid closed and planar curve as the base.";
    }
  }
}
# ---------- end prism ----------
panel = Panel(prism.out)
geometry = Geometry(prism.prismGeometry)
entwine = Entwine(Branch00=prism.volume, Branch01=geometry, FlattenInputs=True)
panel_2 = Panel(entwine)
