# Grasshopper definition 003_001_004_Pyramid.gh (Grasshopper 1.0.7)
# plug-ins: RhinoCodePluginGH, Bifocals

# ----
# C# | Mathematics | Grasshopper
# ALL DOWNLOADS AT:
# www.wickersonstudios.com
# Part 3: Area, Volume and Surface Area
# 3.2 Volume
# 003_002_004_Pyramid
# gpt-4 Text Prompt
# Use this script editor template to create a script
#  for the C# node in grasshopper for rhino8 that
# models geometry for the
# 
# VOLUME
# 
# and specifically the
# 
# PYRAMID V = (1/3)*(A(b)*h)
# 
# //Grasshopper Script Instance
# //#! csharp
# using System;
# using System.Collections;
# using System.Collections.Generic;
# using System.Drawing;
# 
# using Rhino;
# using Rhino.Geometry;
# 
# using Grasshopper;
# using Grasshopper.Kernel;
# using Grasshopper.Kernel.Data;
# using Grasshopper.Kernel.Types;
# 
# public class Script_Instance : GH_ScriptInstance
# {
#   /*
#     Members:
#       RhinoDoc RhinoDocument
#       GH_Document GrasshopperDocument
#       IGH_Component Component
#       int Iteration
# 
#     Methods (Virtual & overridable):
#       Print(string text)
#       Print(string format, params object[] args)
#       Reflect(object obj)
#       Reflect(object obj, string method_name)
#   */
# 
#   private void RunScript(object x, object y, out object a)
#   {
#     // Write your logic here
#     a = null;
#   }
# }
# BASIC SCRIPT
# V= 1/3×A(b)×h
panel = Panel("4")
# To compute the volume of a pyramid using the
# formula
# 
# V= 1/3×A(b)×h, where
# 
# A(b) is the base area and
# h is the height, you can integrate that into the
# provided Grasshopper script template for Rhino.
polygon = Polygon(Plane=PlaneXY(0, 0, 0), Radius=3, Segments=panel, FilletRadius=0)  # -> Polygon, Length
boundary_surfaces = BoundarySurfaces(Edges=polygon.Polygon)
pyramid = Script(baseSurface=boundary_surfaces, height=Slider(5.84, range=0..10))  # -> out, volume, pyramidGeometry; inputs baseSurface: Surface, height: Double
# ---------- pyramid: C# ----------
using System;
using System.Collections.Generic;
using System.Drawing;

using Rhino;
using Rhino.Geometry;

using Grasshopper;
using Grasshopper.Kernel;
using Grasshopper.Kernel.Data;
using Grasshopper.Kernel.Types;

public class Script_Instance : GH_ScriptInstance
{
  
  private void RunScript(Rhino.Geometry.Surface baseSurface, double height, out object volume, out object pyramidGeometry)
  {
    // Initialize outputs
    volume = 0;
    pyramidGeometry = null;

    if(baseSurface == null)
    {
      Print("Invalid base surface provided!");
      return;
    }

    // Compute the base area using AreaMassProperties
    AreaMassProperties amp = AreaMassProperties.Compute(baseSurface);
    if (amp == null)
    {
      Print("Failed to compute the base area!");
      return;
    }
    double baseArea = amp.Area;

    // Compute the volume using the formula
    volume = (1.0 / 3.0) * baseArea * height;

    // Compute the centroid of the base surface
    Point3d centroid = amp.Centroid;

    // Calculate the apex of the pyramid
    Vector3d normal = baseSurface.NormalAt(baseSurface.Domain(0).Mid, baseSurface.Domain(1).Mid);
    Point3d apex = centroid + normal * height;

    // Get the vertices of the base surface
    List<Point3d> vertices = new List<Point3d>();
    foreach (var vertex in baseSurface.ToBrep().Vertices)
    {
        vertices.Add(vertex.Location);
    }

    // Connect each vertex to the apex to form the pyramid's sides
    List<Brep> sideBreps = new List<Brep>();
    for (int i = 0; i < vertices.Count; i++)
    {
        Point3d start = vertices[i];
        Point3d end = vertices[(i + 1) % vertices.Count]; // Ensure a loop back to the first vertex
        Brep side = Brep.CreateFromCornerPoints(start, end, apex, RhinoDoc.ActiveDoc.ModelAbsoluteTolerance);
        if (side != null)
        {
            sideBreps.Add(side);
        }
    }

    // Join the sides and the base to form a closed pyramid
    List<Brep> allBreps = new List<Brep>(sideBreps) { baseSurface.ToBrep() };
    pyramidGeometry = Brep.JoinBreps(allBreps, RhinoDoc.ActiveDoc.ModelAbsoluteTolerance)[0];
  }
}
# ---------- end pyramid ----------
panel_2 = Panel(pyramid.out)
geometry = Geometry(pyramid.pyramidGeometry)
entwine = Entwine(Branch00=pyramid.volume, Branch01=geometry, FlattenInputs=True)
panel_3 = Panel(entwine)
