# Grasshopper definition 003_001_004_Rhombus.gh (Grasshopper 1.0.7)
# plug-ins: RhinoCodePluginGH

# ----
# C# | Mathematics | Grasshopper
# ALL DOWNLOADS AT:
# www.wickersonstudios.com
# Part 3: Area, Volume and Surface Area
# 3.1 Area:
# 003_001_004_Rhombus
# gpt-4 Text Prompt
# To create a script that models a rhombus based
# on two diagonals in Grasshopper for Rhino8,
# you'll need to understand the properties of a
# rhombus.
# 
# Given two diagonals d1 and d2 of a rhombus:
# 
# The diagonals bisect each other at right angles.
# Half the product of the diagonals gives the area
# of the rhombus.
# Let's create a Grasshopper script using C# that
# calculates a rhombus using the two diagonals:
# Use this script editor template to create a script
#  for the C# node in grasshopper for rhino8 that
# models geometry for the
# 
# AREA
# 
# and specifically the
# 
# RHOMBUS
# 
# //Grasshopper Script Instance
# //#! csharp
# using System;
# using System.Collections;
# using System.Collections.Generic;
# using System.Drawing;
# 
# using Rhino;
# using Rhino.Geometry;
# 
# using Grasshopper;
# using Grasshopper.Kernel;
# using Grasshopper.Kernel.Data;
# using Grasshopper.Kernel.Types;
# 
# public class Script_Instance : GH_ScriptInstance
# {
#   /*
#     Members:
#       RhinoDoc RhinoDocument
#       GH_Document GrasshopperDocument
#       IGH_Component Component
#       int Iteration
# 
#     Methods (Virtual & overridable):
#       Print(string text)
#       Print(string format, params object[] args)
#       Reflect(object obj)
#       Reflect(object obj, string method_name)
#   */
# 
#   private void RunScript(object x, object y, out object a)
#   {
#     // Write your logic here
#     a = null;
#   }
# }
# BASIC SCRIPT
# Rhombus = new PolylineCurve(corners)
number_slider = Slider(10, range=0..10)
rhombus = Script(d1=number_slider, d2=Slider(3.54, range=0..10))  # -> out, Area, Rhombus; inputs d1: Double, d2: Double
# ---------- rhombus: C# ----------
//Grasshopper Script Instance
//#! csharp
using System;
using System.Collections;
using System.Collections.Generic;
using System.Drawing;

using Rhino;
using Rhino.Geometry;

using Grasshopper;
using Grasshopper.Kernel;
using Grasshopper.Kernel.Data;
using Grasshopper.Kernel.Types;

public class Script_Instance : GH_ScriptInstance
{
  /* 
    Members:
      RhinoDoc RhinoDocument
      GH_Document GrasshopperDocument
      IGH_Component Component
      int Iteration

    Methods (Virtual & overridable):
      Print(string text)
      Print(string format, params object[] args)
      Reflect(object obj)
      Reflect(object obj, string method_name)
  */
  
  private void RunScript(double d1, double d2, out object Area, out object Rhombus)
  {
    // Assign default values to the outputs
    Area = null;
    Rhombus = null;
    
    // Calculate the area of the rhombus
    Area = 0.5 * d1 * d2;
    
    // Create the rhombus using the diagonals
    Point3d origin = Point3d.Origin;
    Point3d pt1 = new Point3d(d1 * 0.5, 0, 0);
    Point3d pt2 = new Point3d(0, d2 * 0.5, 0);
    Point3d pt3 = new Point3d(-d1 * 0.5, 0, 0);
    Point3d pt4 = new Point3d(0, -d2 * 0.5, 0);

    List<Point3d> corners = new List<Point3d> { pt1, pt2, pt3, pt4, pt1 };
    Rhombus = new PolylineCurve(corners);
  }
}
# ---------- end rhombus ----------
panel = Panel(rhombus.out)
entwine = Entwine(Branch00=rhombus.Rhombus, FlattenInputs=True)
panel_2 = Panel(entwine)
