# Grasshopper definition 003_001_005_Tetrahedron.gh (Grasshopper 1.0.7)
# plug-ins: RhinoCodePluginGH, Bifocals

# ----
# BASIC SCRIPT
# Volume = (Math.Sqrt(2) / 12) * Math.Pow(a, 3)
number_slider = Slider(5.84, range=0..10)
# C# | Mathematics | Grasshopper
# ALL DOWNLOADS AT:
# www.wickersonstudios.com
# Part 3: Area, Volume and Surface Area
# 3.2 Volume
# 003_002_005_Tetrahedron
# To create a script that models the geometry for
# a tetrahedron and calculates its volume based
# on the provided formula
# V = sqrt(2)/12*a^3
#  , we can follow these steps:
# 
# Take an input for the side length 'a' of the
# tetrahedron.
# Compute the volume using the given formula.
# Model the geometry for the tetrahedron based
# on its side length.
# Output the volume and the tetrahedron
# geometry.
# gpt-4 Text Prompt
# Use this script editor template to create a script
#  for the C# node in grasshopper for rhino8 that
# models geometry for the
# 
# VOLUME
# 
# and specifically the
# 
# TETRAHEDRON V = sqrt(2)/12*a^3
# 
# //Grasshopper Script Instance
# //#! csharp
# using System;
# using System.Collections;
# using System.Collections.Generic;
# using System.Drawing;
# 
# using Rhino;
# using Rhino.Geometry;
# 
# using Grasshopper;
# using Grasshopper.Kernel;
# using Grasshopper.Kernel.Data;
# using Grasshopper.Kernel.Types;
# 
# public class Script_Instance : GH_ScriptInstance
# {
#   /*
#     Members:
#       RhinoDoc RhinoDocument
#       GH_Document GrasshopperDocument
#       IGH_Component Component
#       int Iteration
# 
#     Methods (Virtual & overridable):
#       Print(string text)
#       Print(string format, params object[] args)
#       Reflect(object obj)
#       Reflect(object obj, string method_name)
#   */
# 
#   private void RunScript(object x, object y, out object a)
#   {
#     // Write your logic here
#     a = null;
#   }
# }
number_slider_2 = Slider(5.03, range=0..10)
tetrahedron = Script(a=number_slider, h=Slider(5.03, range=0..10))  # -> out, Volume, Tetrahedron; inputs a: Double, h: Double
# ---------- tetrahedron: C# ----------
//Grasshopper Script Instance
//#! csharp
using System;
using System.Collections;
using System.Collections.Generic;
using System.Drawing;

using Rhino;
using Rhino.Geometry;

using Grasshopper;
using Grasshopper.Kernel;
using Grasshopper.Kernel.Data;
using Grasshopper.Kernel.Types;

public class Script_Instance : GH_ScriptInstance
{
  private void RunScript(double a, double h, out object Volume, out object Tetrahedron)
  {
    // Calculate volume
    Volume = (Math.Sqrt(2) / 12) * Math.Pow(a, 3);

    // Model tetrahedron geometry
    Point3d p0 = Point3d.Origin;
    Point3d p1 = new Point3d(a, 0, 0);
    Point3d p2 = new Point3d(a * 0.5, (Math.Sqrt(3) / 2) * a, 0);
    Point3d p3 = new Point3d(a * 0.5, a / (2 * Math.Sqrt(3)), h);

    // Create the surfaces for the tetrahedron
    Brep baseSurface = NurbsSurface.CreateFromCorners(p0, p1, p2, p2).ToBrep();
    Brep side1 = NurbsSurface.CreateFromCorners(p0, p1, p3, p3).ToBrep();
    Brep side2 = NurbsSurface.CreateFromCorners(p1, p2, p3, p3).ToBrep();
    Brep side3 = NurbsSurface.CreateFromCorners(p2, p0, p3, p3).ToBrep();

    // Join the surfaces to create a solid Brep
    Brep[] joinedBrep = Brep.JoinBreps(new List<Brep> { baseSurface, side1, side2, side3 }, Rhino.RhinoDoc.ActiveDoc.ModelAbsoluteTolerance);
    
    if(joinedBrep.Length > 0)
        Tetrahedron = joinedBrep[0];
    else
        Tetrahedron = null;
  }
}
# ---------- end tetrahedron ----------
tetrahedron_2 = Script(a=Slider(5.84, range=0..10), h=number_slider_2)  # -> out, Volume, Tetrahedron; inputs a: Double, h: Double
# ---------- tetrahedron_2: C# ----------
//Grasshopper Script Instance
//#! csharp
using System;
using System.Collections;
using System.Collections.Generic;
using System.Drawing;

using Rhino;
using Rhino.Geometry;

using Grasshopper;
using Grasshopper.Kernel;
using Grasshopper.Kernel.Data;
using Grasshopper.Kernel.Types;

public class Script_Instance : GH_ScriptInstance
{
  private void RunScript(double a, double h, out object Volume, out object Tetrahedron)
  {
    // Calculate volume
    Volume = (Math.Sqrt(2) / 12) * Math.Pow(a, 3);

    // Model tetrahedron geometry
    Point3d p0 = Point3d.Origin;
    Point3d p1 = new Point3d(a, 0, 0);
    Point3d p2 = new Point3d(a * 0.5, (Math.Sqrt(3) / 2) * a, 0);
    Point3d p3 = new Point3d(a * 0.5, a / (2 * Math.Sqrt(3)), h);

    List<Line> tetraEdges = new List<Line>
    {
        new Line(p0, p1),
        new Line(p1, p2),
        new Line(p2, p0),
        new Line(p0, p3),
        new Line(p1, p3),
        new Line(p2, p3)
    };

    Tetrahedron = tetraEdges;
  }
}
# ---------- end tetrahedron_2 ----------
panel = Panel(tetrahedron.out)
panel_2 = Panel(tetrahedron_2.out)
geometry = Geometry(tetrahedron.Tetrahedron)
geometry_2 = Geometry(tetrahedron_2.Tetrahedron)
entwine = Entwine(Branch00=tetrahedron.Volume, Branch01=geometry, FlattenInputs=True)
entwine_2 = Entwine(Branch00=tetrahedron_2.Volume, Branch01=geometry_2, FlattenInputs=True)
panel_3 = Panel(entwine)
panel_4 = Panel(entwine_2)
