# Grasshopper definition 003_001_006_Octahedron.gh (Grasshopper 1.0.7)
# plug-ins: RhinoCodePluginGH, Bifocals

# ----
# Use this script editor template to create a script
#  for the C# node in grasshopper for rhino8 that
# models geometry for the
# 
# VOLUME
# 
# and specifically the
# 
# OCTAHEDRON V = sqrt(2)/12*a^3
# 
# //Grasshopper Script Instance
# //#! csharp
# using System;
# using System.Collections;
# using System.Collections.Generic;
# using System.Drawing;
# 
# using Rhino;
# using Rhino.Geometry;
# 
# using Grasshopper;
# using Grasshopper.Kernel;
# using Grasshopper.Kernel.Data;
# using Grasshopper.Kernel.Types;
# 
# public class Script_Instance : GH_ScriptInstance
# {
#   /*
#     Members:
#       RhinoDoc RhinoDocument
#       GH_Document GrasshopperDocument
#       IGH_Component Component
#       int Iteration
# 
#     Methods (Virtual & overridable):
#       Print(string text)
#       Print(string format, params object[] args)
#       Reflect(object obj)
#       Reflect(object obj, string method_name)
#   */
# 
#   private void RunScript(object x, object y, out object a)
#   {
#     // Write your logic here
#     a = null;
#   }
# }
# BASIC SCRIPT
# V = (Math.Sqrt(2) / 12) * Math.Pow(a, 3)
number_slider = Slider(5.18, range=0..10)
# C# | Mathematics | Grasshopper
# ALL DOWNLOADS AT:
# www.wickersonstudios.com
# Part 3: Area, Volume and Surface Area
# 3.2 Volume
# 003_002_006_Octahedron
# If you want a script that models the geometry of
# an octahedron and calculates its volume in the
# Grasshopper environment for Rhino 8, I can
# help with that. Below is a script that creates an
# octahedron and calculates its volume:
# gpt-4 Text Prompt
construct_point = ConstructPoint(XCoordinate=0, YCoordinate=0, ZCoordinate=0)
octahedron = Script(center=construct_point, edgeLength=number_slider)  # -> out, geo, vol; inputs center: Point3d, edgeLength: Double
# ---------- octahedron: C# ----------
//Grasshopper Script Instance
//#! csharp
using System;
using System.Collections;
using System.Collections.Generic;
using System.Drawing;

using Rhino;
using Rhino.Geometry;

using Grasshopper;
using Grasshopper.Kernel;
using Grasshopper.Kernel.Data;
using Grasshopper.Kernel.Types;

public class Script_Instance : GH_ScriptInstance
{
  // ... same members ...

  private void RunScript(Rhino.Geometry.Point3d center, double edgeLength, out object geo, out object vol)
  {
    Mesh octMesh = CreateOctahedron(center, edgeLength);
    double octVolume = CalculateOctahedronVolume(edgeLength);

    geo = octMesh;
    vol = octVolume;
  }

  private Mesh CreateOctahedron(Point3d center, double a)
  {
    Mesh m = new Mesh();
    
    // Calculate half length for convenience
    double halfA = a * 0.5;

    // Vertices of the octahedron
    Point3d top = new Point3d(center.X, center.Y, center.Z + halfA);
    Point3d bottom = new Point3d(center.X, center.Y, center.Z - halfA);
    Point3d front = new Point3d(center.X, center.Y + halfA, center.Z);
    Point3d back = new Point3d(center.X, center.Y - halfA, center.Z);
    Point3d left = new Point3d(center.X - halfA, center.Y, center.Z);
    Point3d right = new Point3d(center.X + halfA, center.Y, center.Z);

    // Add vertices to the mesh
    m.Vertices.Add(top);
    m.Vertices.Add(bottom);
    m.Vertices.Add(front);
    m.Vertices.Add(back);
    m.Vertices.Add(left);
    m.Vertices.Add(right);

    // Create the faces
    m.Faces.AddFace(0, 2, 4);
    m.Faces.AddFace(0, 4, 3);
    m.Faces.AddFace(0, 3, 5);
    m.Faces.AddFace(0, 5, 2);
    m.Faces.AddFace(1, 4, 2);
    m.Faces.AddFace(1, 3, 4);
    m.Faces.AddFace(1, 5, 3);
    m.Faces.AddFace(1, 2, 5);

    return m;
  }

  private double CalculateOctahedronVolume(double a)
  {
    return (Math.Sqrt(2) / 12) * Math.Pow(a, 3);
  }
}
# ---------- end octahedron ----------
geometry = Geometry(octahedron.geo)
mesh_edges = MeshEdges(Mesh=geometry)  # -> NakedEdges, InteriorEdges, NonManifoldEdges
panel = Panel(octahedron.out)
entwine = Entwine(
    Branch00=geometry,
    Branch01=octahedron.vol,
    Branch02=mesh_edges.NakedEdges,
    Branch03=mesh_edges.InteriorEdges,
    Branch04=mesh_edges.NonManifoldEdges,
    FlattenInputs=True)
panel_2 = Panel(entwine)
