# Grasshopper definition 003_001_006_Quadrilateral.gh (Grasshopper 1.0.7)
# plug-ins: RhinoCodePluginGH

# ----
# C# | Mathematics | Grasshopper
# ALL DOWNLOADS AT:
# www.wickersonstudios.com
# Part 3: Area, Volume and Surface Area
# 3.1 Area:
# 003_001_005_Trapezium
# gpt-4 Text Prompt
# Alright, the goal is to create a simple trapezium
#  (or trapezoid in some terminologies) in
# Grasshopper using the provided C# script
# template. The trapezium is defined by two
# parallel sides and the distance between them.
# 
# Here's a simple implementation that takes the
# base lengths
# b1 and
# b2 and the height
# h as inputs to produce the trapezium:
# Use this script editor template to create a script
#  for the C# node in grasshopper for rhino8 that
# models geometry for the
# 
# AREA
# 
# and specifically the
# 
# TRAPEZIUM
# 
# //Grasshopper Script Instance
# //#! csharp
# using System;
# using System.Collections;
# using System.Collections.Generic;
# using System.Drawing;
# 
# using Rhino;
# using Rhino.Geometry;
# 
# using Grasshopper;
# using Grasshopper.Kernel;
# using Grasshopper.Kernel.Data;
# using Grasshopper.Kernel.Types;
# 
# public class Script_Instance : GH_ScriptInstance
# {
#   /*
#     Members:
#       RhinoDoc RhinoDocument
#       GH_Document GrasshopperDocument
#       IGH_Component Component
#       int Iteration
# 
#     Methods (Virtual & overridable):
#       Print(string text)
#       Print(string format, params object[] args)
#       Reflect(object obj)
#       Reflect(object obj, string method_name)
#   */
# 
#   private void RunScript(object x, object y, out object a)
#   {
#     // Write your logic here
#     a = null;
#   }
# }
# BASIC SCRIPT
# Rhombus = new PolylineCurve(corners)
number_slider = Slider(3.25, range=0..10)
trapezium = Script(b1=number_slider, b2=Slider(5.67, range=0..10), h=Slider(5.46, range=0..10))  # -> out, trapezium; inputs b1: Double, b2: Double, h: Double
# ---------- trapezium: C# ----------
using System;
using System.Collections;
using System.Collections.Generic;
using System.Drawing;

using Rhino;
using Rhino.Geometry;

using Grasshopper;
using Grasshopper.Kernel;
using Grasshopper.Kernel.Data;
using Grasshopper.Kernel.Types;

public class Script_Instance : GH_ScriptInstance
{
  /* 
    Members:
      RhinoDoc RhinoDocument
      GH_Document GrasshopperDocument
      IGH_Component Component
      int Iteration

    Methods (Virtual & overridable):
      Print(string text)
      Print(string format, params object[] args)
      Reflect(object obj)
      Reflect(object obj, string method_name)
  */
  
  private void RunScript(double b1, double b2, double h, out object trapezium)
  {
    if (b1 > 0 && b2 > 0 && h > 0) // check if all inputs are positive
    {
      Point3d pt1 = new Point3d(0, 0, 0);
      Point3d pt2 = new Point3d(b1, 0, 0);
      Point3d pt3 = new Point3d((b1 + b2) * 0.5, h, 0);
      Point3d pt4 = new Point3d((b1 - b2) * 0.5, h, 0);

      Polyline pl = new Polyline(new List<Point3d>() { pt1, pt2, pt3, pt4, pt1 });
      trapezium = pl;
    }
    else
    {
      trapezium = null;
      Print("All inputs should be positive values.");
    }
  }
}
# ---------- end trapezium ----------
polyline = PolyLine(Vertices=trapezium.trapezium, Closed=False)
panel = Panel(trapezium.out)
entwine = Entwine(Branch00=trapezium.trapezium, Branch01=polyline, FlattenInputs=True)
panel_2 = Panel(entwine)
