# Grasshopper definition 003_001_007_Dodecahedron.gh (Grasshopper 1.0.7)
# plug-ins: Bifocals, RhinoCodePluginGH

# ----
# C# | Mathematics | Grasshopper
# ALL DOWNLOADS AT:
# www.wickersonstudios.com
# Part 3: Area, Volume and Surface Area
# 3.2 Volume
# 003_002_007_Dodecahedron
# To create a Grasshopper component in Rhino
# using C# that models a dodecahedron and
# calculates its volume, you'll need to leverage the
#  Rhino.Geometry namespace to model the
# dodecahedron and use the provided formula to
# calculate its volume.
# gpt-4 Text Prompt
# Use this script editor template to create a script
#  for the C# node in grasshopper for rhino8 that
# models geometry for the
# 
# VOLUME
# 
# and specifically the
# 
# DODECAHEDRON V =( (15+7*sqrt(5))/4)*a^3
# 
# //Grasshopper Script Instance
# //#! csharp
# using System;
# using System.Collections;
# using System.Collections.Generic;
# using System.Drawing;
# 
# using Rhino;
# using Rhino.Geometry;
# 
# using Grasshopper;
# using Grasshopper.Kernel;
# using Grasshopper.Kernel.Data;
# using Grasshopper.Kernel.Types;
# 
# public class Script_Instance : GH_ScriptInstance
# {
#   /*
#     Members:
#       RhinoDoc RhinoDocument
#       GH_Document GrasshopperDocument
#       IGH_Component Component
#       int Iteration
# 
#     Methods (Virtual & overridable):
#       Print(string text)
#       Print(string format, params object[] args)
#       Reflect(object obj)
#       Reflect(object obj, string method_name)
#   */
# 
#   private void RunScript(object x, object y, out object a)
#   {
#     // Write your logic here
#     a = null;
#   }
# }
# BASIC SCRIPT
# volume =
# ((15 + 7 * Math.Sqrt(5)) / 4) * Math.Pow(sideLength, 3)
number_slider = Slider(10, range=0..10)  # disabled
construct_point = ConstructPoint(XCoordinate=0, YCoordinate=0, ZCoordinate=0)  # disabled
dodecahedron = Script(a=number_slider, center=construct_point)  # -> out, Polyhedron; inputs a: Double, center: Point3d; disabled
# ---------- dodecahedron: C# ----------
//Grasshopper Script Instance
//#! csharp
using System;
using System.Collections;
using System.Collections.Generic;
using System.Drawing;

using Rhino;
using Rhino.Geometry;

using Grasshopper;
using Grasshopper.Kernel;
using Grasshopper.Kernel.Data;
using Grasshopper.Kernel.Types;

using System;
using Rhino;
using Rhino.Geometry;

public class Script_Instance : GH_ScriptInstance
{
    private void RunScript(double a, Rhino.Geometry.Point3d center, out object Polyhedron)
    {
        double phi = (1 + Math.Sqrt(5)) / 2; // Golden ratio

        // Scaling factor to make the edge length equal to 'a'
        double scale = a / (phi + 1);

        // Vertex coordinates for a unit-edged dodecahedron
        Point3d[] vertices = {
            new Point3d(1, 1, 1) * scale,
            new Point3d(1, 1, -1) * scale,
            new Point3d(1, -1, 1) * scale,
            new Point3d(1, -1, -1) * scale,
            new Point3d(-1, 1, 1) * scale,
            new Point3d(-1, 1, -1) * scale,
            new Point3d(-1, -1, 1) * scale,
            new Point3d(-1, -1, -1) * scale,
            new Point3d(0, phi, 1/phi) * scale,
            new Point3d(0, phi, -1/phi) * scale,
            new Point3d(0, -phi, 1/phi) * scale,
            new Point3d(0, -phi, -1/phi) * scale,
            new Point3d(1/phi, 0, phi) * scale,
            new Point3d(1/phi, 0, -phi) * scale,
            new Point3d(-1/phi, 0, phi) * scale,
            new Point3d(-1/phi, 0, -phi) * scale,
            new Point3d(phi, 1/phi, 0) * scale,
            new Point3d(phi, -1/phi, 0) * scale,
            new Point3d(-phi, 1/phi, 0) * scale,
            new Point3d(-phi, -1/phi, 0) * scale
        };

        // Move vertices to the defined center
        for (int i = 0; i < vertices.Length; i++)
        {
            vertices[i] += center;
        }

        // Create the mesh and add the vertices
        Mesh mesh = new Mesh();
        mesh.Vertices.AddVertices(vertices);

        // Faces of the dodecahedron
        int[][] faces = {
            new [] {0, 12, 14, 4, 16},
            new [] {0, 16, 2, 10, 6},
            new [] {0, 6, 7, 9, 12},
            new [] {8, 4, 14, 6, 10},
            new [] {8, 10, 2, 17, 1},
            new [] {8, 1, 3, 5, 4},
            new [] {5, 18, 19, 15, 9},
            new [] {5, 9, 7, 11, 13},
            new [] {5, 13, 1, 17, 18},
            new [] {7, 11, 3, 13, 15},
            new [] {3, 17, 2, 16, 18},
            new [] {3, 18, 19, 15, 11}
        };

        foreach (var face in faces)
        {
            Point3d centroid = Point3d.Add(
                Point3d.Add(
                    Point3d.Add(vertices[face[0]], vertices[face[1]]),
                    Point3d.Add(vertices[face[2]], vertices[face[3]])
                ),
                vertices[face[4]]
            ) / 5;

            int centroidIndex = mesh.Vertices.Add(centroid);

            mesh.Faces.AddFace(face[0], face[1], centroidIndex);
            mesh.Faces.AddFace(face[1], face[2], centroidIndex);
            mesh.Faces.AddFace(face[2], face[3], centroidIndex);
            mesh.Faces.AddFace(face[3], face[4], centroidIndex);
            mesh.Faces.AddFace(face[4], face[0], centroidIndex);
        }

        Polyhedron = mesh;
    }
}
# ---------- end dodecahedron ----------
mesh_edges = MeshEdges(Mesh=dodecahedron.Polyhedron)  # -> NakedEdges, InteriorEdges, NonManifoldEdges; disabled
geometry = Geometry(dodecahedron.Polyhedron)  # disabled
panel = Panel(dodecahedron.out)  # disabled
entwine = Entwine(Branch00=geometry, Branch01=mesh_edges.InteriorEdges, FlattenInputs=True)  # disabled
panel_2 = Panel(entwine)  # disabled
