# Grasshopper definition 003_001_007_Rectangle_with_Rounded_Corners.gh (Grasshopper 1.0.7)
# plug-ins: RhinoCodePluginGH

# ----
# BASIC SCRIPT
number_slider = Slider(10, range=0..10)
number_slider_2 = Slider(3.89, range=0..10)
# C# | Mathematics | Grasshopper
# ALL DOWNLOADS AT:
# www.wickersonstudios.com
# Part 3: Area, Volume and Surface Area
# 3.1 Area:
# 003_001_007_rectangle_with_rounded_corners
# gpt-4 Text Prompt
# Use this script editor template to create a script
#  for the C# node in grasshopper for rhino8 that
# models geometry for the
# 
# AREA
# 
# and specifically the
# 
# RECTANGLE WITH ROUNDED CORNERS
# 
# //Grasshopper Script Instance
# //#! csharp
# using System;
# using System.Collections;
# using System.Collections.Generic;
# using System.Drawing;
# 
# using Rhino;
# using Rhino.Geometry;
# 
# using Grasshopper;
# using Grasshopper.Kernel;
# using Grasshopper.Kernel.Data;
# using Grasshopper.Kernel.Types;
# 
# public class Script_Instance : GH_ScriptInstance
# {
#   /*
#     Members:
#       RhinoDoc RhinoDocument
#       GH_Document GrasshopperDocument
#       IGH_Component Component
#       int Iteration
# 
#     Methods (Virtual & overridable):
#       Print(string text)
#       Print(string format, params object[] args)
#       Reflect(object obj)
#       Reflect(object obj, string method_name)
#   */
# 
#   private void RunScript(object x, object y, out object a)
#   {
#     // Write your logic here
#     a = null;
#   }
# }
number_slider_3 = Slider(0, range=0..10)
number_slider_4 = Slider(10, range=0..10)
# Given the provided script editor template for
# Grasshopper in Rhino8, I'll create a C# script for
#  modeling a rectangle with rounded corners
# (commonly referred to as a filleted rectangle) in
# the specified "AREA" section. The script will
# take the base point of the rectangle, its width,
# height, and the corner radius as input and
# output the resultant geometry.
construct_point = ConstructPoint(XCoordinate=number_slider_3, YCoordinate=0, ZCoordinate=0)
construct_plane = ConstructPlane(Origin=construct_point, XAxis=Vector(1, 0, 0), YAxis=Vector(0, 1, 0))
rectangle = Rectangle(Plane=construct_plane, XSize=number_slider_4, YSize=number_slider, Radius=number_slider_2)  # -> Rectangle, Length
rectangle_with_rounded_corners = Script(origin=construct_point, width=number_slider_4, height=number_slider, filletRadius=number_slider_2)  # -> out, a; inputs origin: Point3d, width: Double, height: Double, filletRadius: Double
entwine = Entwine(Branch00=rectangle_with_rounded_corners.a, FlattenInputs=True)
panel = Panel(rectangle_with_rounded_corners.out)
panel_2 = Panel(entwine)
