# Grasshopper definition 003_001_007b_Dodecahedron.gh (Grasshopper 1.0.7)
# plug-ins: RhinoCodePluginGH

# ----
# C# | Mathematics | Grasshopper
# ALL DOWNLOADS AT:
# www.wickersonstudios.com
# Part 3: Area, Volume and Surface Area
# 3.2 Volume
# 003_002_007b_Dodecahedron
# gpt-4 Text Prompt
# Given the brief, let's break down the task:
# 
# We need to create tessellations of irregular
# pentagons on a sphere.
# The pentagons will be derived from trapezoids.
# These irregular pentagons have various internal
# angles.
# For simplicity's sake, I'll generate just one
# configuration of an irregular pentagon that
# tessellates on a sphere. To create more
# configurations, one would need to implement
# amore robust approach.
# Use this script editor template to create a script
#  for the C# node in grasshopper for rhino8 that
# models geometry for the
# 
# VOLUME
# 
# and specifically the
# 
# The following post shows 4 transitional spherical
#  tessellations of 60 congruent irregular
# pentagons, starting with trapezoids. There is an
# infinite number of intermediate variations of
# irregular pentagons that form spherical
# tessellations. The numbers are the values of
# internal angles.
# 
# //Grasshopper Script Instance
# //#! csharp
# using System;
# using System.Collections;
# using System.Collections.Generic;
# using System.Drawing;
# 
# using Rhino;
# using Rhino.Geometry;
# 
# using Grasshopper;
# using Grasshopper.Kernel;
# using Grasshopper.Kernel.Data;
# using Grasshopper.Kernel.Types;
# 
# public class Script_Instance : GH_ScriptInstance
# {
#   /*
#     Members:
#       RhinoDoc RhinoDocument
#       GH_Document GrasshopperDocument
#       IGH_Component Component
#       int Iteration
# 
#     Methods (Virtual & overridable):
#       Print(string text)
#       Print(string format, params object[] args)
#       Reflect(object obj)
#       Reflect(object obj, string method_name)
#   */
# 
#   private void RunScript(object x, object y, out object a)
#   {
#     // Write your logic here
#     a = null;
#   }
# }
# BASIC SCRIPT
polygon = Polygon(Plane=PlaneXY(0, 0, 0), Radius=3, Segments=6, FilletRadius=0)  # -> Polygon, Length
sphere = Sphere(Base=PlaneXY(0, 0, 0), Radius=1)
dodecahedron = Script(x=polygon.Polygon, y=sphere)  # -> out, a; inputs x: Polyline, y: list of Surface
# ---------- dodecahedron: C# ----------
using System;
using System.Collections.Generic;
using Rhino;
using Rhino.Geometry;
using Grasshopper;
using Grasshopper.Kernel;
using Grasshopper.Kernel.Data;
using Grasshopper.Kernel.Types;

public class Script_Instance : GH_ScriptInstance
{
    private void RunScript(Rhino.Geometry.Polyline x, System.Collections.Generic.IEnumerable<Rhino.Geometry.Surface> y, out object a)
    {
        // Define pentagon internal angles
        double[] angles = new double[5] { Math.PI / 3, Math.PI / 3, Math.PI / 3, Math.PI / 3, Math.PI / 3 }; // Adjust as per your angles
        
        // Create pentagon
        double radius = 1.0;
        Polyline pentagon = CreateIrregularPentagon(radius, angles);
        
        // Project pentagon onto a sphere
        Point3d sphereCenter = Point3d.Origin;
        double sphereRadius = radius * 1.2; // Just a bit bigger than pentagon's radius
        List<Point3d> sphericalPentagonPoints = new List<Point3d>();
        foreach (Point3d pt in pentagon)
        {
            Vector3d toCenter = pt - sphereCenter;
            toCenter.Unitize();  // Make the vector a unit vector
            Point3d projectedPt = sphereCenter + toCenter * sphereRadius;
            sphericalPentagonPoints.Add(projectedPt);
        }

        a = new PolylineCurve(sphericalPentagonPoints);
    }

    private Polyline CreateIrregularPentagon(double radius, double[] angles)
    {
        if (angles.Length != 5)
            throw new ArgumentException("Angles array must have 5 values.");

        List<Point3d> pentagonPoints = new List<Point3d>();
        double currentAngle = 0.0;
        Point3d currentPoint = new Point3d(radius, 0, 0);
        pentagonPoints.Add(currentPoint);

        for (int i = 0; i < 4; i++) // Only iterate 4 times to generate 5 points
        {
            currentAngle += angles[i];
            currentPoint = new Point3d(
                currentPoint.X + radius * Math.Cos(currentAngle),
                currentPoint.Y + radius * Math.Sin(currentAngle),
                0
            );
            pentagonPoints.Add(currentPoint);
        }
        
        return new Polyline(pentagonPoints);
    }
}
# ---------- end dodecahedron ----------
panel = Panel(dodecahedron.out)
geometry = Geometry(dodecahedron.a)
entwine = Entwine(Branch00=geometry, FlattenInputs=True)
panel_2 = Panel(entwine)
