# Grasshopper definition 003_001_008_Icosahedron.gh (Grasshopper 1.0.7)
# plug-ins: Bifocals, RhinoCodePluginGH

# ----
# C# | Mathematics | Grasshopper
# ALL DOWNLOADS AT:
# www.wickersonstudios.com
# Part 3: Area, Volume and Surface Area
# 3.2 Volume
# 003_002_008_Icosahedron
# To create a Grasshopper component in Rhino
# using C# that models a dodecahedron and
# calculates its volume, you'll need to leverage the
#  Rhino.Geometry namespace to model the
# dodecahedron and use the provided formula to
# calculate its volume.
# gpt-4 Text Prompt
# Use this script editor template to create a script
#  for the C# node in grasshopper for rhino8 that
# models geometry for the
# 
# VOLUME
# 
# and specifically the
# 
# ICOSAHEDRON V = ((5*(3+sqrt(5))/4)*a^3
# 
# //Grasshopper Script Instance
# //#! csharp
# using System;
# using System.Collections;
# using System.Collections.Generic;
# using System.Drawing;
# 
# using Rhino;
# using Rhino.Geometry;
# 
# using Grasshopper;
# using Grasshopper.Kernel;
# using Grasshopper.Kernel.Data;
# using Grasshopper.Kernel.Types;
# 
# public class Script_Instance : GH_ScriptInstance
# {
#   /*
#     Members:
#       RhinoDoc RhinoDocument
#       GH_Document GrasshopperDocument
#       IGH_Component Component
#       int Iteration
# 
#     Methods (Virtual & overridable):
#       Print(string text)
#       Print(string format, params object[] args)
#       Reflect(object obj)
#       Reflect(object obj, string method_name)
#   */
# 
#   private void RunScript(object x, object y, out object a)
#   {
#     // Write your logic here
#     a = null;
#   }
# }
# BASIC SCRIPT
number_slider = Slider(8.4, range=0..10)
icosahedron = Script(sideLength=number_slider)  # -> out, volume, icosahedron; inputs sideLength: Double
# ---------- icosahedron: C# ----------
using System;
using System.Collections;
using System.Collections.Generic;
using System.Drawing;

using Rhino;
using Rhino.Geometry;

using Grasshopper;
using Grasshopper.Kernel;
using Grasshopper.Kernel.Data;
using Grasshopper.Kernel.Types;

public class Script_Instance : GH_ScriptInstance
{
  private void RunScript(double sideLength, out object volume, out object icosahedron)
  {
    Mesh icoMesh = CreateIcosahedron(sideLength);
    icosahedron = icoMesh;
    volume = CalculateIcosahedronVolume(sideLength);
  }

  private Mesh CreateIcosahedron(double sideLength)
  {
    double phi = (1.0 + Math.Sqrt(5.0)) / 2.0; // golden ratio

    List<Point3d> vertices = new List<Point3d>
    {
      new Point3d(-1,  phi, 0),
      new Point3d( 1,  phi, 0),
      new Point3d(-1, -phi, 0),
      new Point3d( 1, -phi, 0),

      new Point3d(0, -1,  phi),
      new Point3d(0,  1,  phi),
      new Point3d(0, -1, -phi),
      new Point3d(0,  1, -phi),

      new Point3d( phi, 0, -1),
      new Point3d( phi, 0,  1),
      new Point3d(-phi, 0, -1),
      new Point3d(-phi, 0,  1)
    };

    List<MeshFace> faces = new List<MeshFace>
    {
      new MeshFace(0, 11, 5),
      new MeshFace(0, 5, 1),
      new MeshFace(0, 1, 7),
      new MeshFace(0, 7, 10),
      new MeshFace(0, 10, 11),
      new MeshFace(1, 5, 9),
      new MeshFace(5, 11, 4),
      new MeshFace(11, 10, 2),
      new MeshFace(10, 7, 6),
      new MeshFace(7, 1, 8),
      new MeshFace(3, 9, 4),
      new MeshFace(3, 4, 2),
      new MeshFace(3, 2, 6),
      new MeshFace(3, 6, 8),
      new MeshFace(3, 8, 9),
      new MeshFace(4, 9, 5),
      new MeshFace(2, 4, 11),
      new MeshFace(6, 2, 10),
      new MeshFace(8, 6, 7),
      new MeshFace(9, 8, 1)
    };

    Mesh mesh = new Mesh();
    mesh.Vertices.AddVertices(vertices);
    mesh.Faces.AddFaces(faces);

    double scaleFactor = sideLength / (2 * Math.Acos(0.5 / phi));
    Transform scaleTransform = Transform.Scale(Point3d.Origin, scaleFactor);
    mesh.Transform(scaleTransform);
    
    return mesh;
  }

  private double CalculateIcosahedronVolume(double sideLength)
  {
    double phi = (1.0 + Math.Sqrt(5.0)) / 2.0; 
    return (5.0 * (3.0 + Math.Sqrt(5.0)) / 12.0) * sideLength * sideLength * sideLength;
  }
}
# ---------- end icosahedron ----------
geometry = Geometry(icosahedron.icosahedron)
mesh_edges = MeshEdges(Mesh=icosahedron.icosahedron)  # -> NakedEdges, InteriorEdges, NonManifoldEdges
panel = Panel(icosahedron.out)
entwine = Entwine(Branch00=geometry, Branch01=mesh_edges.InteriorEdges, FlattenInputs=True)
panel_2 = Panel(entwine)
