# Grasshopper definition 003_001_010_Polygon.gh (Grasshopper 1.0.7)
# plug-ins: RhinoCodePluginGH

# ----
# BASIC SCRIPT
# double sideLength =
# Math.Sqrt((4 * Area * Math.Tan(Math.PI / NumSides)) / NumSides)
number_slider = Slider(6, range=0..10)
# C# | Mathematics | Grasshopper
# ALL DOWNLOADS AT:
# www.wickersonstudios.com
# Part 3: Area, Volume and Surface Area
# 3.1 Area:
# 003_001_010_Polygon
# gpt-4 Text Prompt
# Given your request, I'll help you create a C#
# script inside Grasshopper for Rhino 8 to model
# a regular polygon based on a specified area.
# 
# The formula for the area of a regular polygon is:
# double sideLength =
# Math.Sqrt((4 * Area * Math.Tan(Math.PI / NumSides)) / NumSides);
# Use this script editor template to create a script
#  for the C# node in grasshopper for rhino8 that
# models geometry for the
# 
# AREA
# 
# and specifically the
# 
# REGULAR POLYGON
# 
# //Grasshopper Script Instance
# //#! csharp
# using System;
# using System.Collections;
# using System.Collections.Generic;
# using System.Drawing;
# 
# using Rhino;
# using Rhino.Geometry;
# 
# using Grasshopper;
# using Grasshopper.Kernel;
# using Grasshopper.Kernel.Data;
# using Grasshopper.Kernel.Types;
# 
# public class Script_Instance : GH_ScriptInstance
# {
#   /*
#     Members:
#       RhinoDoc RhinoDocument
#       GH_Document GrasshopperDocument
#       IGH_Component Component
#       int Iteration
# 
#     Methods (Virtual & overridable):
#       Print(string text)
#       Print(string format, params object[] args)
#       Reflect(object obj)
#       Reflect(object obj, string method_name)
#   */
# 
#   private void RunScript(object x, object y, out object a)
#   {
#     // Write your logic here
#     a = null;
#   }
# }
number_slider_2 = Slider(3.18, range=0..10)
construct_point = ConstructPoint(XCoordinate=0, YCoordinate=0, ZCoordinate=0)
regular_polygon = Script(Area=number_slider_2, NumSides=number_slider, Center=construct_point)  # -> out, Polygon; inputs Area: Double, NumSides: Int32, Center: Point3d
# ---------- regular_polygon: C# ----------
using System;
using System.Collections;
using System.Collections.Generic;
using System.Drawing;

using Rhino;
using Rhino.Geometry;

using Grasshopper;
using Grasshopper.Kernel;
using Grasshopper.Kernel.Data;
using Grasshopper.Kernel.Types;

public class Script_Instance : GH_ScriptInstance
{
  private void RunScript(double Area, int NumSides, Rhino.Geometry.Point3d Center, out object Polygon)
  {
    Polygon = null;  // Initialize to null

    if(NumSides < 3)
    {
      Print("Number of sides should be 3 or more.");
      return;
    }

    // Calculate the side length from the given area and number of sides
    double sideLength = Math.Sqrt((4 * Area * Math.Tan(Math.PI / NumSides)) / NumSides);

    // Create the polygon
    Polygon = CreateRegularPolygon(Center, sideLength, NumSides);
  }

  private Polyline CreateRegularPolygon(Point3d center, double sideLength, int numSides)
  {
    Polyline polygon = new Polyline(numSides + 1);
    double angleIncrement = 2 * Math.PI / numSides;

    for(int i = 0; i < numSides; i++)
    {
      double x = center.X + sideLength * Math.Cos(i * angleIncrement);
      double y = center.Y + sideLength * Math.Sin(i * angleIncrement);
      polygon.Add(new Point3d(x, y, center.Z));
    }

    polygon.Add(polygon[0]);  // Close the polyline by adding the first point to the end
    return polygon;
  }
}
# ---------- end regular_polygon ----------
polyline = PolyLine(Vertices=regular_polygon.Polygon, Closed=False)
panel = Panel(regular_polygon.out)
boundary_surfaces = BoundarySurfaces(Edges=polyline)
entwine = Entwine(Branch00=regular_polygon.Polygon, Branch01=polyline, Branch02=boundary_surfaces, FlattenInputs=True)
panel_2 = Panel(entwine)
