# Grasshopper definition 003_004_001_Diagonal_of_a_Rectangle.gh (Grasshopper 1.0.7)
# plug-ins: Bifocals, RhinoCodePluginGH

# ----
# 3.4 Miscellaneous
# 003_004_001_Diagonal_of_a_Rectangle
# gpt-4 Text Prompt
# Use this script editor template to create a script
#  for the C# node in grasshopper for rhino8 that
# models geometry for the
# 
# MISCELLANEOUS
# 
# and specifically the
# 
# DIAGONAL OF A RECTANGLE d = sqrt(l^2 + w^2)
# 
# //Grasshopper Script Instance
# //#! csharp
# using System;
# using System.Collections;
# using System.Collections.Generic;
# using System.Drawing;
# 
# using Rhino;
# using Rhino.Geometry;
# 
# using Grasshopper;
# using Grasshopper.Kernel;
# using Grasshopper.Kernel.Data;
# using Grasshopper.Kernel.Types;
# 
# public class Script_Instance : GH_ScriptInstance
# {
#   /*
#     Members:
#       RhinoDoc RhinoDocument
#       GH_Document GrasshopperDocument
#       IGH_Component Component
#       int Iteration
# 
#     Methods (Virtual & overridable):
#       Print(string text)
#       Print(string format, params object[] args)
#       Reflect(object obj)
#       Reflect(object obj, string method_name)
#   */
# 
#   private void RunScript(object x, object y, out object a)
#   {
#     // Write your logic here
#     a = null;
#   }
# }
# BASIC SCRIPT
# d = sqrt(l^2 + w^2)
number_slider = Slider(4, range=0..10)
# C# | Mathematics | Grasshopper
# ALL DOWNLOADS AT:
# www.wickersonstudios.com
# Part 3: Area, Volume and Surface Area
# Certainly! Here's a script based on the provided
#  template that calculates the diagonal of a
# rectangle using the formula
number_slider_2 = Slider(10, range=0..10)
range = Range(Domain=number_slider_2, Steps=number_slider)
diagonal_of_a_rectangle = Script(l=range, w=Slider(6.79, range=0..10))  # -> out, rect, d, diagonal; inputs l: Double, w: Double
# ---------- diagonal_of_a_rectangle: C# ----------
//Grasshopper Script Instance
//#! csharp
using System;
using System.Collections;
using System.Collections.Generic;
using System.Drawing;

using Rhino;
using Rhino.Geometry;

using Grasshopper;
using Grasshopper.Kernel;
using Grasshopper.Kernel.Data;
using Grasshopper.Kernel.Types;

public class Script_Instance : GH_ScriptInstance
{
  /* 
    Members:
      RhinoDoc RhinoDocument
      GH_Document GrasshopperDocument
      IGH_Component Component
      int Iteration

    Methods (Virtual & overridable):
      Print(string text)
      Print(string format, params object[] args)
      Reflect(object obj)
      Reflect(object obj, string method_name)
  */
  
  private void RunScript(double l, double w, out object rect, out object d, out object diagonal)
  {
    // Generate the rectangle geometry based on the Plane.WorldXY
    Plane basePlane = Plane.WorldXY;
    rect = new Rectangle3d(basePlane, new Interval(0, l), new Interval(0, w));
    
    // Calculate the diagonal length of the rectangle
    d = Math.Sqrt(Math.Pow(l, 2) + Math.Pow(w, 2));
    
    // Generate the diagonal line geometry using rectangle vertices
    Point3d startPoint = new Point3d(0, 0, 0); // bottom-left
    Point3d endPoint = new Point3d(l, w, 0);  // top-right
    diagonal = new Line(startPoint, endPoint);
  }
}
# ---------- end diagonal_of_a_rectangle ----------
geometry = Geometry(diagonal_of_a_rectangle.rect)
geometry_2 = Geometry(diagonal_of_a_rectangle.diagonal)
polar_array = PolarArray(Geometry=diagonal_of_a_rectangle.diagonal, Plane=PlaneXY(0, 0, 0), Count=number_slider, Angle=6.283185307)  # -> Geometry, Transform
panel = Panel(diagonal_of_a_rectangle.out)
polar_array_2 = PolarArray(
    Geometry=[diagonal_of_a_rectangle.rect, diagonal_of_a_rectangle.diagonal],
    Plane=PlaneXY(0, 0, 0),
    Count=number_slider,
    Angle=6.283185307)  # -> Geometry, Transform
geometry_3 = Geometry(polar_array.Geometry)
entwine = Entwine(
    Branch00=geometry,
    Branch01=diagonal_of_a_rectangle.d,
    Branch02=geometry_2,
    Branch03=polar_array_2.Geometry,
    Branch04=geometry_3,
    FlattenInputs=True)
panel_2 = Panel(entwine)
